# Grasshopper definition Assignment_03_Michael_Rauch.gh (Grasshopper 1.0.7)
# plug-ins: Weaverbird, Kangaroo2 Components, Hops

# GridMesh
panel = Panel("http://127.0.0.1:5000")

# ----
# Shortest Path
mesh = Mesh([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])
wbjoin = WeaverbirdsJoinMeshesAndWeld(Mesh=mesh, Weld=False)
clean = CombineClean(Meshes=wbjoin)

concat = Concatenate(FragmentA=panel, FragmentB="/gridMesh")
concat_2 = Concatenate(FragmentA="http://127.0.0.1:5000", FragmentB="/shortestpath")
panel_2 = Panel(concat)
panel_3 = Panel(concat_2)
hops = Hops(
    _Path=concat,
    UCount=Slider(25, range=0..100),
    VCount=Slider(14, range=0..100),
    CacheResultsInMemory=True,
    CacheSolveResults=True,
    RemoteDefinitionLocation="http://127.0.0.1:5000/gridMesh",
    RemoteSolveVersion=(0, 1, 0),
    ShowInput_Enabled=False,
    ShowInput_Path=True,
    SynchronousSolve=True)
triremesh = TriRemesh(Geometry=clean, Length=Slider(3, range=1..3), Iterations=25)  # -> Triangulation, Dual, Creases

# ----
# Result
geo = Geometry(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)

preview = CustomPreview(Geometry=triremesh.Triangulation, Material=ColourSwatch(SwatchColor=RGBA(201, 255, 250, 84)))
explodemesh = GhPythonScript(m=triremesh.Triangulation)  # -> out, a; inputs m: Mesh
# ---------- explodemesh: Python ----------
import Rhino.Geometry as rg

ghenv.Component.Message = "explode mesh"

exploded = []

for i in range(m.Faces.Count):
    m_copy = m.Duplicate()
    face = m_copy.Faces.ExtractFaces([i])
    exploded.append(face)
    
a = exploded
# ---------- end explodemesh ----------
hops_2 = Hops(
    _Path=concat_2,
    InputMesh=triremesh.Triangulation,
    FaceIndex1=Slider(10, range=0..1000),
    FaceIndex2=Slider(90, range=0..1000),
    CacheResultsInMemory=True,
    CacheSolveResults=True,
    RemoteDefinitionLocation="http://127.0.0.1:5000/shortestpath",
    RemoteSolveVersion=(0, 1, 0),
    ShowInput_Enabled=False,
    ShowInput_Path=True,
    SynchronousSolve=True)
item = ListItem(List=explodemesh.a, Index=hops_2, Wrap=True)

# ----
# Result
swatch = ColourSwatch(SwatchColor=RGB(0, 81, 255))
geo_2 = Geometry([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])
preview_2 = CustomPreview(Geometry=geo_2, Material=swatch)
