# Grasshopper definition MPDA22-session03_hops.gh (Grasshopper 1.0.7)
# plug-ins: Kangaroo2 Components, Hops, MeshEdit Components

number_slider = Slider(5, range=0..10)
subd = SubD(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)
concat = Concatenate(FragmentA="http://127.0.0.1:5000", FragmentB="/meshFromPoints")
mplane = MeshPlane(
    Boundary={Plane=PlaneXY(0, 0, 0), Size=Domain2(u=-10..10, v=-10..10)},
    WidthCount=number_slider,
    HeightCount=number_slider)  # -> Mesh, Area
meshsubd = MeshFromSubD(SubD=subd, Density=Slider(1, range=0..2))
triremesh = TriRemesh(Geometry=meshsubd, Length=Slider(2, range=1..2), Iterations=25)  # -> Triangulation, Dual, Creases
panel = Panel(concat)
concat_2 = Concatenate(FragmentA="http://127.0.0.1:5000", FragmentB="/shortestpath")
pop2d = Populate2D(Region={Plane=PlaneXY(0, 0, 0), Size=Domain2(u=0..20, v=0..10)}, Count=Slider(6, range=0..10), Seed=1)
data = Data(triremesh.Triangulation)
data_2 = Data(meshsubd)
mesh = Mesh(data)
panel_2 = Panel(concat_2)
clean = CombineClean(Meshes=data_2)
hops = Hops(
    _Path=concat,
    Points=pop2d,
    CacheResultsInMemory=False,
    CacheSolveResults=False,
    RemoteDefinitionLocation="http://127.0.0.1:5000/meshFromPoints",
    RemoteSolveVersion=(0, 1, 0),
    ShowInput_Enabled=False,
    ShowInput_Path=True,
    SynchronousSolve=True)
points = PointList(Points=pop2d, Size=Slider(2, range=0..10))
number_slider_2 = Slider(5, range=0..100)
number_slider_3 = Slider(15, range=0..100)
explodemesh = GhPythonScript(m=mesh)  # -> out, a; inputs m: Mesh
# ---------- explodemesh: Python ----------
import Rhino.Geometry as rg

ghenv.Component.Message = "explode mesh"

exploded = []

for i in range(m.Faces.Count):
    m_copy = m.Duplicate()
    face = m_copy.Faces.ExtractFaces([i])
    exploded.append(face)
    
a = exploded
# ---------- end explodemesh ----------
explodemesh_2 = GhPythonScript(m=clean)  # -> out, a; inputs m: Mesh; same code as explodemesh
panel_3 = Panel(hops)
area = MeshArea(Mesh=explodemesh.a)  # -> Area, Centroid
hops_2 = Hops(
    _Path=concat_2,
    InputMesh=mesh,
    FaceIndex1=Slider(140, range=0..1000),
    FaceIndex2=Slider(65, range=0..1000),
    CacheResultsInMemory=False,
    CacheSolveResults=False,
    RemoteDefinitionLocation="http://127.0.0.1:5000/shortestpath",
    RemoteSolveVersion=(0, 1, 0),
    ShowInput_Enabled=False,
    ShowInput_Path=True,
    SynchronousSolve=True)
points_2 = PointList(Points=area.Centroid)
concat_3 = Concatenate(FragmentA="http://127.0.0.1:5000", FragmentB="/meshgraph")
item = ListItem(List=explodemesh.a, Index=hops_2, Wrap=True)
panel_4 = Panel(concat_3)
hops_3 = Hops(
    _Path=concat_3,
    InputMesh=clean,
    Plot=Button(),
    Save=Button(),
    CacheResultsInMemory=False,
    CacheSolveResults=False,
    RemoteDefinitionLocation="http://127.0.0.1:5000/meshgraph",
    RemoteSolveVersion=(0, 1, 0),
    ShowInput_Enabled=False,
    ShowInput_Path=True,
    SynchronousSolve=True)
panel_5 = Panel(hops_3)
