# Grasshopper definition MPDA22_session03_mesh.gh (Grasshopper 1.0.7)

geo = Geometry(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)
geo_2 = Geometry(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)
pt = Point([Point(-2.676169622, 0.169963128, 0), Point(1.949014919, 16.2172564, 0), Point(18.2884039, 10.96227995, 7.851779715), Point(15.4476803, -3.836479617, 13.29754082), Point(24.84412384, -5.423274566, 0)])
points = PointList(Points=pt, Size=Slider(2, range=0..10))
python = GhPythonScript(iPts=pt)  # -> out, a; inputs iPts: list of Point3d
# ---------- python: Python ----------
import Rhino.Geometry as rg

### how to make a simple mesh

#instantiate a new mesh in rhinocommon
mesh = rg.Mesh()

#print(iPts)
#print( type(iPts) )


#1. fill in some vertices 
for p in iPts:
    mesh.Vertices.Add(p)
print ( "vertex count:" , len(mesh.Vertices) )

#2. add some faces to the mesh
mesh.Faces.AddFace(0,1,2,3)
mesh.Faces.AddFace(0,3,4)


#mesh.Faces.AddFace(0,1,4)
#mesh.Faces.AddFace(1,2,4)
#mesh.Faces.AddFace(2,3,4)
print ( "faces count:" , len(mesh.Faces) )

#outputs
a = mesh
# ---------- end python ----------
panel = Panel(pt)
panel_2 = Panel(python.a)
demesh = DeconstructMesh(Mesh=python.a)  # -> Vertices, Faces, Colours, Normals
python_2 = GhPythonScript()  # -> out, a
# ---------- python_2: Python ----------
import ghpythonlib

nested = [ [1,2] , [3,4] , [5,6]  ]

a = ghpythonlib.treehelpers.list_to_tree(nested)
# ---------- end python_2 ----------
python_3 = GhPythonScript(iSrf=geo, U=Slider(12, range=1..20), V=Slider(10, range=1..20))  # -> out, a, b; inputs iSrf: Surface, U: Int32, V: Int32
# ---------- python_3: Python ----------
import Rhino.Geometry as rg
import ghpythonlib.treehelpers as th


#1. GET POINTS IN SURFACE
#reparametrize surface
#print (iSrf.Domain(U),  iSrf.Domain(V) )
intervalU = rg.Interval(0,1)
iSrf.SetDomain( 0, intervalU )

intervalV = rg.Interval(0,1)
iSrf.SetDomain( 1, intervalV )


all_pts = []
for i in range(U+1):
    Upts= []
    for j in range(V+1):
        pt = iSrf.PointAt(i/U, j/V)
        Upts.append(pt)
    all_pts.append(Upts)



#2. BUILD MESH FROM POINTS

bigmesh = rg.Mesh()

for i in range( len(all_pts)-1):
    for j in range( len(all_pts[i])-1):
        
        facemesh = rg.Mesh()
        pt1 = all_pts[i][j]
        pt2 = all_pts[i][j+1]
        pt3 = all_pts[i+1][j+1]
        pt4 = all_pts[i+1][j]
        
        facemesh.Vertices.Add(pt1)
        facemesh.Vertices.Add(pt2)
        facemesh.Vertices.Add(pt3)
        facemesh.Vertices.Add(pt4)

        facemesh.Faces.AddFace(0,1,2,3)
        
        bigmesh.Append(facemesh)

#compute normals for visualization
bigmesh.Normals.ComputeNormals()
#bigmesh.Compact()

#OUTPUT
a = th.list_to_tree(all_pts)
b = bigmesh
# ---------- end python_3 ----------
